# Grasshopper definition Comma Centre.ghx (Grasshopper 1.0.7)

number_slider = Slider(1850, range=0..2000)
number_slider_2 = Slider(6000, range=0..7000)
crv = Curve()

knob = ControlKnob(Decimals=0, Limit=True, Maximum=99, Minimum=0, Range=10, Value=7)
list = ValueList({"ALPHA": "ALPHA.a.", "Beta": "Beta.0.", "Stable": " "}, selected="ALPHA")
ver = VersionCreate(P="「Comma Centre」", D=[list, Slider(1, range=1..9)], V=Slider(1, range=0..9), D_2=knob)
panel = Panel(ver)

number_slider_3 = Slider(420, range=0..1000)

panel_2 = Panel("""6000
3940
3440
0
0
6000
6000""")
panel_3 = Panel("""400
310
50
0
-500
-500
400""")
num = Number(number_slider)
pt = ConstructPoint(XCoordinate=0, YCoordinate=panel_2, ZCoordinate=panel_3)
pline = PolyLine(Vertices=pt, Closed=Toggle(True))
boundary = BoundarySurfaces(Edges=pline)
X = UnitX(Factor=num)
extr = Extrude(Base=boundary, Direction=X)

# ---- group: baojieshi
crv_2 = Curve(<curve referenced from the Rhino model>)

# ---- group: dianti1
crv_3 = Curve(<curve referenced from the Rhino model>)

# ---- group: zhongting
crv_4 = Curve(<curve referenced from the Rhino model>)

# ----
pt_2 = ConstructPoint(XCoordinate=Slider(0, range=0..10000), YCoordinate=0, ZCoordinate=0)

# ---- group: dianti2
crv_5 = Curve(<curve referenced from the Rhino model>)

# ----
吧台 = Curve(<curve referenced from the Rhino model>)
crv_6 = Curve(<curve referenced from the Rhino model>)

# ---- group: chufang
crv_7 = Curve(<curve referenced from the Rhino model>)

# ----
crv_8 = Curve(<curve referenced from the Rhino model>)
crv_9 = Curve([<curve referenced from the Rhino model> x2])
crv_10 = Curve(<curve referenced from the Rhino model>)
crv_11 = Curve(<curve referenced from the Rhino model>)
xy = XYPlane(Origin=pt_2)
cpoly = ControlPolygon(Curve=crv_2)  # -> Polygon, Points
Z = UnitZ(Factor=number_slider_3)
crv_12 = Curve(<curve referenced from the Rhino model>)
crv_13 = Curve(<curve referenced from the Rhino model>)
crv_14 = Curve(<curve referenced from the Rhino model>)
panel_4 = Panel("""0
2""")
cpoly_2 = ControlPolygon(Curve=crv_3)  # -> Polygon, Points
cpoly_3 = ControlPolygon(Curve=crv_5)  # -> Polygon, Points
rectangle = Rectangle(Plane=xy, XSize=number_slider, YSize=number_slider_2, Radius=0)  # -> Rectangle, Length
boundary_2 = BoundarySurfaces(Edges=crv_13)
move = Move(Geometry=crv_4, Motion=Z)  # -> Geometry, Transform
panel_5 = Panel("""0
2""")
panel_6 = Panel("""0
2""")
item = ListItem(List=cpoly.Points, Index=graft(panel_4), Wrap=True)
offset = OffsetCurve(Curve=crv_14, Distance=Slider(-40, range=-40..0), Corners=1)
Z_2 = UnitZ(Factor=Slider(100, range=0..200))
boundary_3 = BoundarySurfaces(Edges=crv_12)
item_2 = ListItem(List=cpoly_2.Points, Index=graft(panel_5), Wrap=True)
item_3 = ListItem(List=cpoly_3.Points, Index=graft(panel_6), Wrap=True)
bang = ExplodeTree(Data=item)  # -> Branch0, Branch1
boundary_4 = BoundarySurfaces(Edges=rectangle.Rectangle)
extr_2 = Extrude(Base=boundary_2, Direction=Z_2)
Z_3 = UnitZ(Factor=Slider(200, range=0..200))
boundary_5 = BoundarySurfaces(Edges=flatten([offset, crv_14]), UseTasks=True)
offset_2 = OffsetCurve(Curve=move.Geometry, Distance=Slider(40, range=0..100), Corners=1)
edges = BrepEdges(Brep=move.Geometry)  # -> Naked, Interior, NonManifold
bang_2 = ExplodeTree(Data=item_2)  # -> Branch0, Branch1
bang_3 = ExplodeTree(Data=item_3)  # -> Branch0, Branch1
Z_4 = UnitZ(Factor=Slider(340, range=0..400))
extr_3 = Extrude(Base=boundary_3, Direction=Z_3)
rec_2pt = Rectangle2Pt(Plane=crv_2, PointA=bang.Branch0, PointB=bang.Branch1, Radius=0)  # -> Rectangle, Length
Z_5 = UnitZ(Factor=Slider(20, range=0..400))
Z_6 = UnitZ(Factor=Slider(1000, range=0..10000))
extr_4 = Extrude(Base=boundary_5, Direction=Z_4)
panel_7 = Panel("""0
1
2""")
boundary_6 = BoundarySurfaces(Edges=flatten(offset_2), UseTasks=True)
rec_2pt_2 = Rectangle2Pt(Plane=crv_3, PointA=bang_2.Branch0, PointB=bang_2.Branch1, Radius=Slider(4, range=0..10))  # -> Rectangle, Length
rec_2pt_3 = Rectangle2Pt(Plane=crv_5, PointA=bang_3.Branch0, PointB=bang_3.Branch1, Radius=Slider(4, range=0..10))  # -> Rectangle, Length
extr_5 = Extrude(Base=boundary_4, Direction=Z_6)
offset_3 = OffsetCurve(Curve=rec_2pt.Rectangle, Distance=Slider(-10, range=-40..0), Corners=1)
Z_7 = UnitZ(Factor=Slider(190, range=0..300))
item_4 = ListItem(List=edges.Naked, Index=panel_7, Wrap=True)
boundary_7 = BoundarySurfaces(Edges=crv_6)
boundary_8 = BoundarySurfaces(Edges=crv_11)
Z_8 = UnitZ(Factor=Slider(300, range=0..300))
Z_9 = UnitZ(Factor=Slider(220, range=0..300))
boundary_9 = BoundarySurfaces(Edges=crv_10)
Z_10 = UnitZ(Factor=Slider(300, range=0..300))
boundary_10 = BoundarySurfaces(Edges=crv_9)
Z_11 = UnitZ(Factor=Slider(300, range=0..300))
boundary_11 = BoundarySurfaces(Edges=crv_8)
extr_6 = Extrude(Base=boundary_6, Direction=Z_5)
item_5 = ListItem(List=edges.Naked, Index="3", Wrap=True)

entwine = Entwine(Branch00=extr, FlattenInputs=True)
material = CreateMaterial(
    Diffuse=ColourSwatch(SwatchColor=RGB(128, 128, 128)),
    Specular=RGB(255, 254, 254),
    Emission=RGB(0, 0, 0),
    Transparency=Slider(0.45, range=0..1),
    Shine=0)
preview = CustomPreview(Geometry=entwine, Material=material)

extr_7 = Extrude(Base=boundary_8, Direction=Z_8)
extr_8 = Extrude(Base=boundary_7, Direction=Z_7)
boundary_12 = BoundarySurfaces(Edges=flatten([rec_2pt.Rectangle, offset_3]), UseTasks=True)
extr_9 = Extrude(Base=boundary_11, Direction=Z_9)
extr_10 = Extrude(Base=boundary_9, Direction=Z_10)
extr_11 = Extrude(Base=boundary_10, Direction=Z_11)
Z_12 = UnitZ(Factor=Slider(340, range=0..400))
boundary_13 = BoundarySurfaces(Edges=flatten(rec_2pt_2.Rectangle), UseTasks=True)

number_slider_4 = Slider(1000, range=0..1000)
X_2 = UnitX(Factor=expr("-x", 1))
pt_3 = ConstructPoint(XCoordinate=0, YCoordinate=0, ZCoordinate=0)
line = LineSDL(Start=pt_3, Direction=X_2, Length=number_slider_4)
rectangle_2 = Rectangle(Plane=PlaneXY(0, 0, 0), XSize=Domain(-1, 1), YSize=Domain(-2, 2), Radius=0)  # -> Rectangle, Length
boundary_14 = BoundarySurfaces(Edges=rectangle_2.Rectangle)
division = Division(A=number_slider_4, B=Slider(4, range=2..8))
flip = Flip(Surface=boundary_14)  # -> Surface, Result
textsrf = TextOnSurface(
    Text=panel,
    Font="Futura Bold:no Italic:no",
    Height=division,
    Depth=Slider(20, range=0..50),
    BaseLine=line,
    BaseSurface=flip.Surface)
yz = YZPlane(Origin=Point(0, 0, 0))
xy_2 = XYPlane(Origin=Point(0, 0, 0))
X_3 = UnitX(Factor=1)
mirror = Mirror(Geometry=textsrf, Plane=yz)  # -> Geometry, Transform
rad = Radians(Degrees=Slider(37, range=0..90))
line_2 = LineSDL(Start=xy_2, Direction=X_3, Length=1)
rotax = RotateAxis(Geometry=mirror.Geometry, Angle=rad, Axis=line_2)  # -> Geometry, Transform
material_2 = CreateMaterial(
    Diffuse=ColourSwatch(SwatchColor=RGB(255, 254, 254)),
    Specular=RGB(255, 254, 254),
    Emission=RGB(0, 0, 0),
    Transparency=0,
    Shine=0)
preview_2 = CustomPreview(Geometry=rotax.Geometry, Material=material_2)

boundary_15 = BoundarySurfaces(Edges=flatten(rec_2pt_3.Rectangle), UseTasks=True)
extr_12 = Extrude(Base=boundary_12, Direction=Z_12)
Z_13 = UnitZ(Factor=Slider(1200, range=0..1200))
Z_14 = UnitZ(Factor=Slider(1200, range=0..1200))
Y = UnitY(Factor=Slider(-240, range=-300..0))
extr_13 = Extrude(Base=boundary_13, Direction=Z_13)
extr_14 = Extrude(Base=boundary_15, Direction=Z_14)
move_2 = Move(Geometry=item_5, Motion=Y)  # -> Geometry, Transform
number_slider_5 = Slider(20, range=0..100)

num_2 = Number(number_slider_2)
number_slider_6 = Slider(0, range=0..1000)
number_slider_7 = Slider(5, range=0..10)
number_slider_8 = Slider(1100, range=0..10000)
series = Series(Start=number_slider_6, Step=Slider(60, range=0..100), Count=number_slider_7)
Y_2 = UnitY(Factor=series)
subtraction = Subtraction(A=num_2, B=number_slider_6)
rectangle_3 = Rectangle(Plane=Y_2, XSize=number_slider_8, YSize=subtraction, Radius=0)  # -> Rectangle, Length

Z_15 = UnitZ(Factor=Slider(-500, range=-500..0))
neg = Negative(Value=number_slider_5)
extr_15 = Extrude(Base=[move_2.Geometry, item_5], Direction=Z_15)
Y_3 = UnitY(Factor=[number_slider_5, neg])
sunion = SolidUnion(Breps=extr_15)
X_4 = UnitX(Factor=Slider(20, range=0..50))
extr_16 = Extrude(Base=sunion, Direction=X_4)
number_slider_9 = Slider(20, range=0..50)
subtraction_2 = Subtraction(A=Slider(340, range=0..1000), B=number_slider_9)
subtraction_3 = Subtraction(A=number_slider_3, B=subtraction_2)
Z_16 = UnitZ(Factor=expr("-x", subtraction_3))
extr_17 = Extrude(Base=item_4, Direction=Z_16)
extr_18 = Extrude(Base=extr_17, Direction=Y_3)

# ---- group: fuzhuangshejibangongshi
crv_15 = Curve(<curve referenced from the Rhino model>)

# ----
edges_2 = BrepEdges(Brep=crv_15)  # -> Naked, Interior, NonManifold

num_3 = Number(number_slider_2)
number_slider_10 = Slider(1200, range=0..6000)
number_slider_11 = Slider(5, range=0..10)
series_2 = Series(Start=number_slider_10, Step=Slider(60, range=0..100), Count=number_slider_11)
Y_4 = UnitY(Factor=series_2)
subtraction_4 = Subtraction(A=num_3, B=number_slider_10)
rectangle_4 = Rectangle(Plane=Y_4, XSize=Slider(1100, range=0..10000), YSize=subtraction_4, Radius=0)  # -> Rectangle, Length

# ---- group: kong zhong uo dao
crv_16 = Curve(<curve referenced from the Rhino model>)

# ----
boundary_16 = BoundarySurfaces(Edges=crv_15)

# ---- group: huihuagongzuoshi
crv_17 = Curve(<curve referenced from the Rhino model>)

# ----
Z_17 = UnitZ(Factor=expr("-x", number_slider_9))
item_6 = ListItem(List=edges_2.Naked, Index=0, Wrap=True)
extr_19 = Extrude(Base=boundary_16, Direction=Z_17)
Y_5 = UnitY(Factor=Slider(60, range=0..200))
move_3 = Move(Geometry=item_6, Motion=Y_5)  # -> Geometry, Transform
boundary_17 = BoundarySurfaces(Edges=crv_16)
Z_18 = UnitZ(Factor=expr("-x", Slider(20, range=0..50)))
series_3 = Series(Start=0, Step=1, Count=Slider(5, range=0..10))
panel_8 = Panel("""1
3""")
boundary_18 = BoundarySurfaces(Edges=crv_17)
Z_19 = UnitZ(Factor=expr("-x", Slider(20, range=0..50)))
item_7 = ListItem(List=edges_2.Naked, Index=panel_8, Wrap=True)
extr_20 = Extrude(Base=boundary_17, Direction=Z_18)
graph = GraphMapper(series_3, x0=0, x1=4, y0=0, y1=1, container_name="Bezier", cpx=[0, 0.1819527298, 0.8218189478, 1], cpy=[0, 0, 1, 1])
number_slider_12 = Slider(20, range=0..100)
extr_21 = Extrude(Base=boundary_18, Direction=Z_19)
offset_4 = OffsetCurve(Curve=item_7, Distance=expr("-x", Slider(20, range=0..100)), Corners=1)
eval = EvaluateCurve(Curve=reparameterize(move_3.Geometry), Parameter=graph)  # -> Point, Tangent, Angle

num_4 = Number(number_slider_2)
number_slider_13 = Slider(2300, range=0..6000)
number_slider_14 = Slider(7, range=0..10)
series_4 = Series(Start=number_slider_13, Step=Slider(60, range=0..100), Count=number_slider_14)
Y_6 = UnitY(Factor=series_4)
subtraction_5 = Subtraction(A=num_4, B=number_slider_13)
rectangle_5 = Rectangle(Plane=Y_6, XSize=Slider(1100, range=0..10000), YSize=subtraction_5, Radius=0)  # -> Rectangle, Length

Z_20 = UnitZ(Factor=Slider(1000, range=0..1000))
midpt = CurveMiddle(Curve=move_3.Geometry)
number_slider_15 = Slider(40, range=0..100)
number_slider_16 = Slider(28, range=0..100)
panel_9 = Panel("""1
2
3""")
neg_2 = Negative(Value=number_slider_12)
extr_22 = Extrude(Base=offset_4, Direction=Z_20)
shatter = Shatter(Curve=reparameterize(move_3.Geometry), Parameters=graph)
X_5 = UnitX(Factor=[neg_2, number_slider_12])
item_8 = ListItem(List=eval.Point, Index=panel_9, Wrap=True)
number_slider_17 = Slider(7, range=0..100)
extr_23 = Extrude(Base=flatten(extr_22), Direction=X_5)
dom = ConstructDomain(DomainStart=expr("-x", number_slider_16), DomainEnd=number_slider_16)
len = Length(Curve=shatter)
dom_2 = ConstructDomain(DomainStart=expr("-x", number_slider_15), DomainEnd=number_slider_15)
midpt_2 = CurveMiddle(Curve=shatter)
division_2 = Division(A=len, B="2")
rectangle_6 = Rectangle(Plane=item_8, XSize=dom, YSize=dom_2, Radius=0)  # -> Rectangle, Length
rad_2 = Radians(Degrees=Slider(20, range=0..90))
dom_3 = ConstructDomain(DomainStart=expr("-x", division_2), DomainEnd=division_2)
dom_4 = ConstructDomain(DomainStart=expr("-x", number_slider_17), DomainEnd=number_slider_17)
tan = Tangent(Value=rad_2)
rectangle_7 = Rectangle(Plane=midpt_2, XSize=dom_3, YSize=dom_4, Radius=0)  # -> Rectangle, Length
multiplication = Multiplication(A="1", B=tan)
vec = VectorXYZ(XComponent=0, YComponent="1", ZComponent=multiplication)  # -> Vector, Length
boundary_19 = BoundarySurfaces(Edges=[rectangle_7.Rectangle, rectangle_6.Rectangle])
line_3 = LineSDL(Start=midpt, Direction=vec.Vector, Length=Slider(2824, range=0..5000))
extrcrv = ExtrudeAlong(Base=boundary_19, Curve=line_3)
bang_4 = ExplodeTree(Data=extrcrv)  # -> Branch0, Branch1
vrayrender = VRayRender()
splitmul = SplitBrepMultiple(Brep=extr_23, Cutters=bang_4.Branch1)
flip_2 = FlipMatrix(Data=splitmul)
bang_5 = ExplodeTree(Data=flip_2)  # -> _0000, _0001, _0002, _0003
brep = Brep(bang_5._0002)

# ---- group: kongzhonghuayuan
crv_18 = Curve(<curve referenced from the Rhino model>)

# ----
crv_19 = Curve(<curve referenced from the Rhino model>)
boundary_20 = BoundarySurfaces(Edges=crv_19)
Z_21 = UnitZ(Factor=expr("-x", Slider(20, range=0..50)))
extr_24 = Extrude(Base=boundary_20, Direction=Z_21)

# ---- group: huihuabangongshi
crv_20 = Curve(<curve referenced from the Rhino model>)

# ----
scale_nu = ScaleNU(Geometry=crv_20, Plane=crv_20, ScaleX=1, ScaleY=Slider(0.46, range=0..1), ScaleZ=1)  # -> Geometry, Transform
edges_3 = BrepEdges(Brep=scale_nu.Geometry)  # -> Naked, Interior, NonManifold
boundary_21 = BoundarySurfaces(Edges=scale_nu.Geometry)
Z_22 = UnitZ(Factor=expr("-x", Slider(20, range=0..100)))
item_9 = ListItem(List=edges_3.Naked, Index="2", Wrap=True)
extr_25 = Extrude(Base=boundary_21, Direction=Z_22)
Y_7 = UnitY(Factor=Slider(-60, range=-60..0))
move_4 = Move(Geometry=item_9, Motion=Y_7)  # -> Geometry, Transform
series_5 = Series(Start=0, Step=1, Count=Slider(5, range=0..10))
graph_2 = GraphMapper(series_5, x0=0, x1=4, y0=0, y1=1, container_name="Bezier", cpx=[0, 0.1819527298, 0.8218189478, 1], cpy=[0, 0, 1, 1])
eval_2 = EvaluateCurve(Curve=reparameterize(move_4.Geometry), Parameter=graph_2)  # -> Point, Tangent, Angle
midpt_3 = CurveMiddle(Curve=move_4.Geometry)
number_slider_18 = Slider(40, range=0..100)
number_slider_19 = Slider(28, range=0..100)
panel_10 = Panel("""1
2
3""")
shatter_2 = Shatter(Curve=reparameterize(move_4.Geometry), Parameters=graph_2)
item_10 = ListItem(List=eval_2.Point, Index=panel_10, Wrap=True)
number_slider_20 = Slider(7, range=0..100)
dom_5 = ConstructDomain(DomainStart=expr("-x", number_slider_19), DomainEnd=number_slider_19)
len_2 = Length(Curve=shatter_2)
dom_6 = ConstructDomain(DomainStart=expr("-x", number_slider_18), DomainEnd=number_slider_18)
midpt_4 = CurveMiddle(Curve=shatter_2)
division_3 = Division(A=len_2, B="2")
rectangle_8 = Rectangle(Plane=item_10, XSize=dom_5, YSize=dom_6, Radius=0)  # -> Rectangle, Length
rad_3 = Radians(Degrees=Slider(20, range=0..90))
dom_7 = ConstructDomain(DomainStart=expr("-x", division_3), DomainEnd=division_3)
dom_8 = ConstructDomain(DomainStart=expr("-x", number_slider_20), DomainEnd=number_slider_20)
tan_2 = Tangent(Value=rad_3)
rectangle_9 = Rectangle(Plane=midpt_4, XSize=dom_7, YSize=dom_8, Radius=0)  # -> Rectangle, Length
multiplication_2 = Multiplication(A="1", B=tan_2)
vec_2 = VectorXYZ(XComponent=0, YComponent="1", ZComponent=multiplication_2)  # -> Vector, Length
boundary_22 = BoundarySurfaces(Edges=[rectangle_9.Rectangle, rectangle_8.Rectangle])
line_4 = LineSDL(Start=midpt_3, Direction=vec_2.Vector, Length=Slider(1783, range=0..5000))
extrcrv_2 = ExtrudeAlong(Base=boundary_22, Curve=line_4)
crv_21 = Curve(<curve referenced from the Rhino model>)
boundary_23 = BoundarySurfaces(Edges=crv_21)
Z_23 = UnitZ(Factor=expr("-x", Slider(20, range=0..50)))
extr_26 = Extrude(Base=boundary_23, Direction=Z_23)

# ---- group: 中庭入口切割
crv_22 = Curve(<curve referenced from the Rhino model>)

# ---- group: 机房入口切割
crv_23 = Curve(<curve referenced from the Rhino model>)

# ----
crv_24 = Curve(<curve referenced from the Rhino model>)
boundary_24 = BoundarySurfaces(Edges=crv_24)
Z_24 = UnitZ(Factor=Slider(1000, range=0..10000))
Z_25 = UnitZ(Factor=Slider(100, range=0..100))
extr_27 = Extrude(Base=boundary_24, Direction=Z_24)
move_5 = Move(Geometry=crv_22, Motion=Z_25)  # -> Geometry, Transform
boundary_25 = BoundarySurfaces(Edges=move_5.Geometry)
Z_26 = UnitZ(Factor=Slider(100, range=0..100))
boundary_26 = BoundarySurfaces(Edges=crv_23)
extr_28 = Extrude(Base=boundary_25, Direction=Z_26)
Z_27 = UnitZ(Factor=Slider(190, range=0..200))
extr_29 = Extrude(Base=boundary_26, Direction=Z_27)
entwine_2 = Entwine(
    Branch00=extr_28,
    Branch01=extr_29,
    Branch02=[extr_8, extr_9],
    Branch03=extr_9,
    Branch04=extr_10,
    Branch05=extr_7,
    Branch06=extr_11,
    FlattenInputs=True)  # -> flatten(Result)

number_slider_21 = Slider(20, range=0..100)
series_6 = Series(Start=Slider(0, range=0..1000), Step=number_slider_21, Count=number_slider_7)
Z_28 = UnitZ(Factor=series_6)
move_6 = Move(Geometry=rectangle_3.Rectangle, Motion=Z_28)  # -> Geometry, Transform
Z_29 = UnitZ(Factor=number_slider_21)

bnd = Bounds(Numbers=series_6)
dedomain = DeconstructDomain(Domain=bnd)  # -> Start, End
addition = Addition(A=number_slider_21, B=dedomain.End)

boundary_27 = BoundarySurfaces(Edges=move_6.Geometry)

extr_30 = Extrude(Base=boundary_27, Direction=Z_29)

number_slider_22 = Slider(20, range=0..100)
series_7 = Series(Start=addition, Step=number_slider_22, Count=number_slider_11)
Z_30 = UnitZ(Factor=series_7)
move_7 = Move(Geometry=rectangle_4.Rectangle, Motion=Z_30)  # -> Geometry, Transform
Z_31 = UnitZ(Factor=number_slider_22)

bnd_2 = Bounds(Numbers=series_7)
dedomain_2 = DeconstructDomain(Domain=bnd_2)  # -> Start, End
addition_2 = Addition(A=number_slider_22, B=dedomain_2.End)

boundary_28 = BoundarySurfaces(Edges=move_7.Geometry)

extr_31 = Extrude(Base=boundary_28, Direction=Z_31)

num_5 = Number(number_slider_2)
number_slider_23 = Slider(0, range=0..1000)
number_slider_24 = Slider(5, range=0..10)
series_8 = Series(Start=number_slider_23, Step=Slider(60, range=0..100), Count=number_slider_24)
subtraction_6 = Subtraction(A=num_5, B=number_slider_23)

pt_4 = ConstructPoint(XCoordinate=number_slider_8, YCoordinate=series_8, ZCoordinate=0)

rectangle_10 = Rectangle(Plane=pt_4, XSize=Slider(750, range=0..10000), YSize=subtraction_6, Radius=0)  # -> Rectangle, Length

number_slider_25 = Slider(20, range=0..100)
series_9 = Series(Start=Slider(0, range=0..1000), Step=number_slider_25, Count=number_slider_24)
Z_32 = UnitZ(Factor=series_9)
move_8 = Move(Geometry=rectangle_10.Rectangle, Motion=Z_32)  # -> Geometry, Transform
Z_33 = UnitZ(Factor=number_slider_25)

boundary_29 = BoundarySurfaces(Edges=move_8.Geometry)

extr_32 = Extrude(Base=boundary_29, Direction=Z_33)

number_slider_26 = Slider(20, range=0..100)
series_10 = Series(Start=addition_2, Step=number_slider_26, Count=number_slider_14)
Z_34 = UnitZ(Factor=series_10)
move_9 = Move(Geometry=rectangle_5.Rectangle, Motion=Z_34)  # -> Geometry, Transform
Z_35 = UnitZ(Factor=number_slider_26)

boundary_30 = BoundarySurfaces(Edges=move_9.Geometry)

extr_33 = Extrude(Base=boundary_30, Direction=Z_35)

entwine_3 = Entwine(Branch00=extr_30, Branch01=extr_31, Branch02=extr_33, Branch03=extr_32, FlattenInputs=True)
sunion_2 = SolidUnion(Breps=flatten(entwine_3))
sint = SolidIntersection(BrepsA=sunion_2, BrepsB=extr_5)
sdiff = SolidDifference(BrepsA=sint, BrepsB=extr_27)
sdiff_2 = SolidDifference(BrepsA=sdiff, BrepsB=entwine_2)

material_3 = CreateMaterial(
    Diffuse=ColourSwatch(SwatchColor=RGB(255, 255, 255)),
    Specular=RGB(255, 254, 254),
    Emission=RGB(0, 0, 0),
    Transparency=Slider(0.7, range=0..1),
    Shine=0)
preview_3 = CustomPreview(Geometry=sdiff_2, Material=material_3)

# ==== cluster VersionCreate: 自动更新
D = ClusterInput()  # type
bang = ExplodeTree(Data=graft(D))  # -> Branch0, Branch1
T = Text(bang.Branch0)
entwine = Entwine(Branch00=bang.Branch1, Branch01=".", FlattenInputs=True)  # -> flatten(Result)
tmatch = MatchText(Text=T, Pattern=" ", Case=True)
join = TextJoin(Text=entwine)
P = ClusterInput()
p_n_c = PickNChoose(Pattern=tmatch, Stream0=T, Stream1=join)
D_2 = ClusterInput()
V = ClusterInput()
P_2 = Text(P)
V_2 = Integer(V)
D_3 = Integer(D_2)
entwine_2 = Entwine(Branch00=P_2, Branch02="Ver-", Branch03=p_n_c, Branch04=V_2, Branch05=".", Branch06=D_3, FlattenInputs=True)  # -> flatten(Result)
join_2 = TextJoin(Text=entwine_2)
R = ClusterOutput(join_2)

# ==== cluster VRayRender

timeline = VRayTimeline(FramesCount=Slider(120, range=100..200))  # -> Timeline, CurrentFrame, CurrentFraction

pt = ConstructPoint(XCoordinate=0, YCoordinate=0, ZCoordinate=0)
cosmos = VRayCosmosAsset(
    BasePlane=pt,
    Scale=Slider(0.25, range=0..0.5),
    Visible=Toggle(True),
    Lights=Toggle(True),
    IntensityMultiplier=1,
    ColorMultiplier=ColourSwatch(SwatchColor=RGB(255, 255, 255)))  # -> VGeometry, BoundingBox

stereo = Stereo(
    0,
    Has_Extract_Parameter=False,
    Has_Manage_Collection=False,
    OptionsLength=3,
    Version=1,
    Options=["Off", "Side by Side", "Top Bottom"])
type = Type(
    1,
    Has_Extract_Parameter=False,
    Has_Manage_Collection=False,
    OptionsLength=4,
    Version=1,
    Options=["Standard", "Orthographic", "VR Spherical Panorama", "VR Cube Map"])
pt_2 = ConstructPoint(XCoordinate=0, YCoordinate=0, ZCoordinate=0)
pt_3 = ConstructPoint(XCoordinate=0, YCoordinate=0, ZCoordinate=0)
camera = VRayCamera(
    Type=type,
    Stereo=stereo,
    Position=pt_2,
    Target=pt_3,
    FOV=26.99146652,
    Tilt=0,
    OrthographicZoomFactor=0,
    PhysicalExposureOn=Toggle(True),
    WhiteBalance=ColourSwatch(SwatchColor=RGB(255, 255, 255)),
    FNumber=8,
    ShutterSpeed1S=Slider(50, range=0.1..100),
    FilmSensitivity=Slider(1600, range=100..3200),
    AutoExposure=Toggle(False),
    AutoWhiteBalance=Toggle(False),
    DepthOfFieldFocus=0)  # -> Camera, Angle, ExposureValue

pt_4 = ConstructPoint(XCoordinate=0, YCoordinate=0, ZCoordinate=0)
light_directional = VRayLightDirectional(
    On=Toggle(False),
    Position=pt_4,
    Target=Point(0, 0, 0),
    Color=RGB(255, 255, 255),
    Intensity=Slider(0.25, range=0..0.5),
    ShadowSoftness=Slider(0.5, range=0..1))

texture = Texture(
    File_Picker=0,
    File_Types="All Image Files (*.png; *.bmp; *.tga; *.hdr; *.sgi; *.rgb; *.rgba; *.jpg; *.jpeg; *.exr; *.pic; *.tif; *.tiff; *.tx)|*.png;*.bmp;*.tga;*.hdr;*.sgi;*.rgb;*.rgba;*.jpg;*.jpeg;*.exr;*.pic;*.tif;*.tiff;*.tx|Portable Network Graphics (*.png)|*.png|Windows bitmap (*.bmp)|*.bmp|Targa Image (*.tga)|*.tga|Radiance High-Dynamyc Range (*.hdr)|*.hdr|Silicon Graphics (*.sgi; *.rgb; *.rgba)|*.sgi;*.rgb;*.rgba|JPEG image (*.jpg; *.jpeg)|*.jpg;*.jpeg|OpenEXR image (*.exr)|*.exr|SoftImage PICT (*.pic)|*.pic|Tagged image (*.tif; *.tiff)|*.tif;*.tiff|Tiled mipmapped image file (*.tx)|*.tx",
    Multiple_Files=True)
rig_dome = VRayLightRigDome(
    LightOn=Toggle(False),
    Visible=Toggle(False),
    Texture=texture,
    Intensity=Slider(0.03, range=0..1),
    Rotation=0,
    BackgroundIntensity=1)

graph = GraphMapper(
    timeline.CurrentFraction,
    x0=0,
    x1=1.52,
    y0=0,
    y1=1.52,
    container_name="Bezier",
    cpx=[0, 0.326005429, 0.02638938278, 1],
    cpy=[0, 0.04009175301, 0.5269581079, 1])
gradient = Gradient(
    LowerLimit=0,
    UpperLimit=1,
    Parameter=timeline.CurrentFraction,
    stops=[0: RGB(157, 255, 0), 0.485: RGB(255, 255, 0), 1: RGB(255, 0, 0)])
graph_2 = GraphMapper(
    timeline.CurrentFraction,
    x0=0,
    x1=1,
    y0=19,
    y1=24,
    container_name="Sine Summation",
    Equation0_px=[0.2, 0.4789262116],
    Equation0_py=[0.2, 0.3446460962],
    Equation1_px=[0.1866932809, 0.314386785],
    Equation1_py=[0.4049541354, 0.5476994514])
graph_3 = GraphMapper(
    graph,
    x0=0,
    x1=1.52,
    y0=-19,
    y1=16,
    container_name="Bezier",
    cpx=[0, 0.5474556684, 0.5029165149, 1],
    cpy=[1, 0.03943574429, 0.5637550354, 0.5705647469])

engine = Engine(
    2,
    Has_Extract_Parameter=False,
    Has_Manage_Collection=False,
    OptionsLength=3,
    Version=1,
    Options=["V-Ray Denoiser", "NVIDIA AI Denoiser", "Intel Open Image Denoiser"])
preset = Preset(
    2,
    Has_Extract_Parameter=False,
    Has_Manage_Collection=False,
    OptionsLength=3,
    Version=1,
    Options=["Mild", "Default", "Strong"])
mode = Mode(
    2,
    Has_Extract_Parameter=False,
    Has_Manage_Collection=False,
    OptionsLength=3,
    Version=1,
    Options=["Only Render Elements", "Hide Denoiser Channel", "Show Denoiser Channel"])
denoiser = VRayElementDenoiser(Engine=engine, Preset=preset, Mode=mode)

entwine = Entwine(FlattenInputs=True)
bang = ExplodeTree(Data=entwine)  # -> Branch0, Branch1
mtl_simple = VRayMaterialSimple(
    Diffuse={AColor=RGB(137, 137, 137), FileName="", Float=0, State=2},
    Reflection={AColor=RGB(137, 137, 137), FileName="", Float=0, State=2},
    Glossiness={AColor=RGBA(0, 0, 0, 0), FileName="", Float=0.8500000238, State=4},
    IOR=1.3,
    Opacity={AColor=RGBA(0, 0, 0, 0), FileName="", Float=1, State=4},
    Emission={AColor=RGB(0, 0, 0), FileName="", Float=0, State=2})
vgeo = VRayGeometry(Geo=bang.Branch1, Material=mtl_simple, quality=0)

mtl_name = VRayMaterialFromProject(Has_Extract_Parameter=True, Has_Manage_Collection=False, OptionsLength=0, Version=1)

vgeo_2 = VRayGeometry(Geo=bang.Branch0, Material=mtl_name, quality=0)

entwine_2 = Entwine(Branch00=vgeo_2, Branch01=vgeo, Branch02=cosmos.VGeometry, FlattenInputs=True)

out_img = OutputImage(
    "C:\Users\yukio\Desktop\CubeRender\cube_render.png",
    File_Picker=1,
    File_Types="Portable Network Graphics (*.png)|*.png|Windows bitmap (*.bmp)|*.bmp|Targa Image (*.tga)|*.tga|Radiance High-Dynamyc Range (*.hdr)|*.hdr|Silicon Graphics (*.sgi; *.rgb; *.rgba)|*.sgi;*.rgb;*.rgba|JPEG image (*.jpg; *.jpeg)|*.jpg;*.jpeg|OpenEXR image (*.exr)|*.exr|SoftImage PICT (*.pic)|*.pic|Tagged image (*.tif; *.tiff)|*.tif;*.tiff|Tiled mipmapped image file (*.tx)|*.tx|V-Ray Raw Image (*.vrimg)|*.vrimg",
    Multiple_Files=False)
sampler = Sampler(
    0,
    Has_Extract_Parameter=False,
    Has_Manage_Collection=False,
    OptionsLength=2,
    Version=1,
    Options=["Progressive", "Bucket"])
quality = Quality(
    0,
    Has_Extract_Parameter=False,
    Has_Manage_Collection=False,
    OptionsLength=6,
    Version=1,
    Options=["Low", "Low+", "Medium", "Medium+", "High", "High+"])
engine_2 = Engine(0, Has_Extract_Parameter=False, Has_Manage_Collection=False, OptionsLength=3, Version=1, Options=["CPU", "CUDA", "RTX"])
mode_2 = Mode(
    0,
    Has_Extract_Parameter=False,
    Has_Manage_Collection=False,
    OptionsLength=2,
    Version=1,
    Options=["Interactive", "Production"])
repeat = RepeatData(Data=Slider(480, range=240..2048), Length="2")
render = VRayRender(
    Engine=engine_2,
    Mode=mode_2,
    Sampler=sampler,
    Quality=quality,
    OutputImage=out_img,
    OutputResolution=repeat,
    Camera=camera.Camera,
    LightRig=rig_dome,
    Light=flatten(light_directional),
    VGeometry=flatten(entwine_2),
    Timeline=timeline.Timeline,
    RenderElements=denoiser,
    UpdateEffectsFrequency=100)

render_in_project = VRayRenderInProject(Scene=render)  # disabled
